# Grasshopper definition GH_Debug.gh (Grasshopper 0.9.76)
# plug-ins: GHStructures

crv = Curve([<curve referenced from the Rhino model> x30])
line = Line(crv)
beam = TestComponent(String=line)  # -> Beam, NodeStart, NodeEnd
parameters = GH_Parameters()
pt = Point([<point referenced from the Rhino model> x3])
constraint_pt = GH_ConstPoint(Point=pt)
structure = GH_Structure(Elements=beam.Beam, Nodes=[beam.NodeStart, beam.NodeEnd], ConstraintPoints=constraint_pt, Parameters=parameters)  # -> Structure, Mesh
mesh = Mesh(structure.Mesh)
main = GH_Main(Structure=structure.Structure, Parameters=parameters, ExecuteDR=Toggle(False), ExecuteSizing=Toggle(False))
