# Grasshopper definition grid.gh (Grasshopper 0.9.76)

number_slider = Slider(10, range=0..10)
srf = Surface(<surface referenced from the Rhino model>)
divide = DivideDomain²(Domain=srf, UCount=number_slider, VCount=number_slider)
subsrf = Isotrim(Surface=srf, Domain=divide)
number_slider_2 = Slider(1, range=0..1)
sdivide = DivideSurface(Surface=subsrf, UCount=number_slider_2, VCount=number_slider_2)  # -> simplify(Points), Normals, Parameters
path_mapper = PathMapper(sdivide.Points, source="{A;B}", target="{A}")
ma = MassAddition(Input=path_mapper)  # -> Result, PartialResults
division = Division(A=ma.Result, B=4)
item = ListItem(List=path_mapper, Index=0, Wrap=True)
item_2 = ListItem(List=path_mapper, Index=3, Wrap=True)
item_3 = ListItem(List=path_mapper, Index=1, Wrap=True)
item_4 = ListItem(List=path_mapper, Index=2, Wrap=True)
pt = Point(division)
ln = Line(StartPoint=item_4, EndPoint=pt)  # -> flatten(Line)
ln_2 = Line(StartPoint=item, EndPoint=pt)  # -> flatten(Line)
ln_3 = Line(StartPoint=item_3, EndPoint=pt)  # -> flatten(Line)
ln_4 = Line(StartPoint=item_2, EndPoint=pt)  # -> flatten(Line)
join = JoinCurves(Curves=[ln_2, ln_4], Preserve=False)
join_2 = JoinCurves(Curves=[ln_3, ln], Preserve=False)
