# Grasshopper definition testScripts.gh (Grasshopper 0.9.76)

crv = Curve([<curve referenced from the Rhino model> x156])
crv_2 = Curve([<curve referenced from the Rhino model> x126])
crv_3 = Curve([<curve referenced from the Rhino model> x24])
pt = Point([<point referenced from the Rhino model> x4])
crv_4 = Curve([<curve referenced from the Rhino model> x36])
line = Line(crv)
pt_2 = Point([<point referenced from the Rhino model> x6])
line_2 = Line(crv_2)
line_3 = Line(crv_3)
pt_3 = Point([<point referenced from the Rhino model> x6])
c_script = CSharpScript(
    splines=crv_4,
    pts=pt,
    runDR=Toggle(False),
    runSizing=Toggle(False),
    Reference="C:\Users\jolsson\Documents\Visual Studio 2010\Projects\Structures\Structures\bin\Structures.dll")  # -> out, A; inputs splines: list of Polyline, pts: list of Point3d, runDR: Boolean, runSizing: Boolean
# ---------- c_script: C# ----------
    List<Spline> splineObjs = new List<Spline>();
    List<ConstraintPoint> cpts = new List<ConstraintPoint>();
    Spline sp;
    ConstraintPoint cp;

    foreach(Polyline pl in splines)
    {
      sp = new Spline(pl, eSplineType.BendingSpline);
      splineObjs.Add(sp);
    }

    for(int i = 0; i < pts.Count; i++)
    {
      cp = new ConstraintPoint(pts[i], eConstraint.Pined);
      cpts.Add(cp);
    }

    Parameters pa = new Parameters();
    pa.Draw3dBars = true;
    pa.GravityMagnitude = 0;
    pa.SurfaceLoadMagnitude = 0;

    Structure s = new Structure(splineObjs, cpts, pa);
    Main main = new Main(s, pa);

    if(runDR)
    {
      main.EnableDrawing();
      main.RunDR();
    }
    
    if(runSizing)
    {
      main.EnableDrawing();
      main.RunSizing();
    }
# ---------- end c_script ----------
c_script_2 = CSharpScript(
    beams=line_2,
    cables=line_3,
    pts=pt_3,
    runDR=Toggle(False),
    runSizing=Toggle(False),
    Reference="C:\Users\jolsson\Documents\Visual Studio 2010\Projects\Structures\Structures\bin\Structures.dll")  # -> out, A; inputs beams: list of Line, cables: list of Line, pts: list of Point3d, runDR: Boolean, runSizing: Boolean
# ---------- c_script_2: C# ----------
    List<Edge> edges = new List<Edge>();
    List<Vertex> vertices = new List<Vertex>();
    List<ConstraintPoint> cpts = new List<ConstraintPoint>();
    Node6Dof n6s, n6e;
    Node3Dof n3s, n3e;
    Beam b;
    Cable c;
    ConstraintPoint cp;

    foreach(Line l in beams)
    {
      n6s = new Node6Dof(l.From);
      n6e = new Node6Dof(l.To);
      vertices.Add((Vertex) n6s);
      vertices.Add((Vertex) n6e);

      b = new Beam(n6s, n6e);
      edges.Add((Edge) b);
    }

    foreach(Line l in cables)
    {
      n3s = new Node3Dof(l.From);
      n3e = new Node3Dof(l.To);
      vertices.Add((Vertex) n3s);
      vertices.Add((Vertex) n3e);

      c = new Cable(n3s, n3e);
      edges.Add((Edge) c);
    }

    for(int i = 0; i < pts.Count; i++)
    {
      cp = new ConstraintPoint(pts[i], eConstraint.Pined);
      cpts.Add(cp);
    }

    Parameters pa = new Parameters();
    pa.Draw3dBars = true;

    Structure s = new Structure(vertices, edges, cpts, pa);
    Main main = new Main(s, pa);


    if(runDR)
    {
      main.EnableDrawing();
      main.RunDR();
    }
    
    if(runSizing)
    {
      main.EnableDrawing();
      main.RunSizing();
    }
# ---------- end c_script_2 ----------
panel = Panel("Sizing")
c_script_3 = CSharpScript(
    lines=line,
    pts=pt_2,
    runDR=Toggle(False),
    runSizing=Toggle(False),
    g=Slider(10, range=-10..10),
    Reference="C:\Users\jolsson\Documents\Visual Studio 2010\Projects\Structures\Structures\bin\Structures.dll")  # -> out, A; inputs lines: list of Line, pts: list of Point3d, runDR: Boolean, runSizing: Boolean, g: Double
# ---------- c_script_3: C# ----------
    List<Edge> edges = new List<Edge>();
    List<Vertex> vertices = new List<Vertex>();
    List<ConstraintPoint> cpts = new List<ConstraintPoint>();
    Node6Dof ns, ne;
    Beam b;
    ConstraintPoint cp;

    foreach(Line l in lines)
    {
      ns = new Node6Dof(l.From);
      ne = new Node6Dof(l.To);
      vertices.Add((Vertex) ns);
      vertices.Add((Vertex) ne);

      b = new Beam(ns, ne);
      edges.Add((Edge) b);
    }

    for(int i = 0; i < pts.Count; i++)
    {
      cp = new ConstraintPoint(pts[i], eConstraint.Pined);
      cpts.Add(cp);
    }

    Parameters pa = new Parameters();
    pa.Draw3dBars = true;
    pa.GravityMagnitude = g;

    Structure s = new Structure(vertices, edges, cpts, pa);

    Main main = new Main(s, pa);
    main.DisableDrawing();

    if(runDR)
    {
      main.EnableDrawing();
      main.RunDR();
      main.DisableDrawing();
    }

    if(runSizing)
    {
      main.EnableDrawing();
      main.RunSizing();
      main.DisableDrawing();
    }

    A = s.Get3dBars();
# ---------- end c_script_3 ----------
panel_2 = Panel(c_script.out)
